# Grasshopper definition WoodColumnCrossSection.gh (Grasshopper 0.9.76)

crv = Curve(<curve referenced from the Rhino model>)
list = ValueList({"Simply supported both ends": 1, "Fixed one end": 2, "One end fixed and one end simply supported": 0.699, "Both ends fixed": 1/2}, selected="One end fixed and one end simply supported")
len = Length(Curve=crv)
bending_capacity_in_mpa = Slider(30, range=0..100)
# "Calculation of minimum required moment of inertia for columns"
# 
# "29-09-2017"
# 
# Created by Mikkel Dohm Andersen
load = Slider(1000, range=0..1000)
multiplication = Multiplication(A=list, B=Slider(3000, range=0..10000))
expression = Expression(Ncr=load, E=bending_capacity_in_mpa, ls=multiplication, Expression="(ls^2*Ncr)/(Pi^2*E)")
panel = Panel(expression)
